# Grasshopper definition CgalTest.gh (Grasshopper 1.0.7)

rel = GhPythonScript(path="config.json")  # -> a
# ---------- rel: Python ----------
ghenv.Component.NickName = "Rel"

import rhinoscriptsyntax as rs

dir = rs.DocumentPath()
a = dir + "spec\\" + path
# ---------- end rel ----------
file = ReadFile(File=rel, PerLineParse=False)
dll = ImportDll(asm="CgalUtilWrapper.dll", config=file)  # -> dll
# ---------- dll: Python ----------
ghenv.Component.Name = "Import Dll"
ghenv.Component.NickName = "Dll"

import rhinoscriptsyntax as rs
import System.IO as io
import clr, json

cwd = io.Path.GetDirectoryName(ghenv.Component.OnPingDocument().FilePath) + "/spec/"
io.Directory.SetCurrentDirectory(cwd)

thisDir = rs.DocumentPath();
cfg = json.loads(config)
binDir = io.Directory.GetParent(thisDir).Parent.Parent.FullName + "\\x64\\" + cfg["build"] + "\\"
asmPath = binDir + asm
dll = asmPath

clr.AddReferenceToFileAndPath(asmPath)
# ---------- end dll ----------

pt = Point([Point(54.40490909, 85.79482679, 0), Point(-4.535055939, 84.42762695, 0), Point(-69.00812776, 122.7085133, 0), Point(-83.85608051, -42.6009072, 0), Point(-7.516387235, -80.60551641, 0), Point(-93.18552969, -147.2724749, 0), Point(133.9813093, -123.095073, 0), Point(87.64128893, -34.94829509, 0), Point(163.6993658, 51.68739517, 0)])
pt_2 = Point([Point(117.6796915, 42.27419018, 0), Point(43.98379714, 7.24385474, 0), Point(10.60583601, 48.55321257, 0)])
pt_3 = Point([Point(77.17964876, -5.811189158, 0), Point(60.79919983, -59.10169843, 0), Point(89.70914082, -105.6788256, 0), Point(12.34828021, -109.9617798, 0), Point(19.57576546, -39.29303516, 0)])
pline = PolyLine(Vertices=pt, Closed=True)
pline_2 = PolyLine(Vertices=pt_2, Closed=True)
pline_3 = PolyLine(Vertices=pt_3, Closed=True)
merge = Merge(Data1=pline_3, Data2=pline_2)  # -> flatten(Result)

brep = Brep(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)
mesh = MeshBrep(
    Brep=brep,
    Settings={GridMaxCount=0, GridMinCount=16, JaggedSeams=False, MaxEdgeLength=0, MinEdgeLength=0.0001, MinTolerance=0, Refine=True, RefineAngle=0, RelativeTolerance=0.65, SimplePlanes=True, Tolerance=0})

pt_4 = Point([Point(-378.7577295, -23.80971393, 0), Point(-323.270592, -76.84888942, 0), Point(-367.333907, -126.6241157, 0), Point(-208.0054053, -19.90662726, 0), Point(-254.7276996, -33.35963657, 0), Point(-294.4622466, -43.93240521, 0), Point(-428.9409493, -9.937929571, 0), Point(-291.4470867, -7.081973967, 0), Point(-322.7276731, 23.05812404, 0), Point(-347.3828665, 12.03517673, 0), Point(-340.8143193, -77.25688308, 0), Point(-395.0774758, -109.488382, 0), Point(-295.5270233, -135.5999761, 0), Point(-408.5412665, -78.07287039, 0), Point(-334.7801799, -35.67053364, 0), Point(-309.3336155, -99.782657, 0), Point(-207.5090567, -90.7119904, 0), Point(-243.5691178, -113.6626012, 0), Point(-240.4252242, -33.98148333, 0)])
pt_5 = Point([Point(-81.73192766, -304.197097, -57.44650067), Point(-67.14937479, -382.5497884, 34.18735864), Point(32.34610641, -436.0286096, 0), Point(-7.452086071, -391.255643, -29.77510518), Point(7.47223611, -493.860358, 0), Point(-48.65480583, -493.255527, -137.4610643)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])

c_script = CSharpScript(path="spec/OptimalBoundingBox(Points).py", refresh=Button())  # -> out, A; inputs path: String, refresh: Boolean
# ---------- c_script: C# usings ----------
using System.IO;
# ---------- c_script: C# ----------
    string thisDir = Path.GetDirectoryName(this.Component.OnPingDocument().FilePath);
        string file = File.ReadAllText(thisDir + @"\" + path);
    A = file;
# ---------- end c_script ----------
optimalboundingbox_points = Instance(Code=c_script.A, Dll=dll, Points=pt_5)  # -> Out, Obb

c_script_2 = CSharpScript(path="spec/ConvexHull(Points).py", refresh=Button())  # -> out, A; inputs path: String, refresh: Boolean; same code as c_script
convexhull_points = Instance(Code=c_script_2.A, Dll=dll, Points=pt_5)  # -> Out, Hull

c_script_3 = CSharpScript(path="spec/BoundingSphere.py", refresh=Button())  # -> out, A; inputs path: String, refresh: Boolean; same code as c_script
boundingcircle = Instance(Code=c_script_3.A, Dll=dll, Points=pt_5)  # -> Out, Sphere

c_script_4 = CSharpScript(path="spec/OptimalBoundingBox.py", refresh=Button())  # -> out, A; inputs path: String, refresh: Boolean; same code as c_script
optimalboundingbox = Instance(Code=c_script_4.A, Dll=dll, Mesh=mesh)  # -> Out, Obb

c_script_5 = CSharpScript(path="spec/ConvexHull.py", refresh=Button())  # -> out, A; inputs path: String, refresh: Boolean; same code as c_script
convexhull = Instance(Code=c_script_5.A, Dll=dll, Mesh=mesh)  # -> Out, Hull

c_script_6 = CSharpScript(path="spec/BoundingCircle.py", refresh=Button())  # -> out, A; inputs path: String, refresh: Boolean; same code as c_script
boundingcircle_2 = Instance(Code=c_script_6.A, Dll=dll, Points=pt_4)  # -> Out, Circle

c_script_7 = CSharpScript(path="spec/BoundingRectangle.py", refresh=Button())  # -> out, A; inputs path: String, refresh: Boolean; same code as c_script
boundingrectangle = Instance(Code=c_script_7.A, Dll=dll, Points=pt_4)  # -> Out, Rectangle

c_script_8 = CSharpScript(path="spec/ConvexHull(2).py", refresh=Button())  # -> out, A; inputs path: String, refresh: Boolean; same code as c_script
convexhull_2 = Instance(Code=c_script_8.A, Dll=dll, Points=pt_4)  # -> Out, ConvexHull

c_script_9 = CSharpScript(path="spec/StraightSkeleton.py", refresh=Button())  # -> out, A; inputs path: String, refresh: Boolean; same code as c_script
straightskeleton = Instance(Code=c_script_9.A, Dll=dll, Outer=pline, Inner=merge)  # -> Out, StraightSkeleton, Spokes, Envelope
panel = Panel(straightskeleton.Out)

medges = MeshEdges(Mesh=convexhull_points.Hull)  # -> NakedEdges, InteriorEdges, NonManifoldEdges
merge_2 = Merge(Data1=medges.NakedEdges, Data2=medges.InteriorEdges, Data3=medges.NonManifoldEdges)
preview = CustomPreview(Geometry=convexhull_points.Hull, Material=ColourSwatch(SwatchColor=RGBA(21, 255, 0, 106)))

medges_2 = MeshEdges(Mesh=convexhull.Hull)  # -> NakedEdges, InteriorEdges, NonManifoldEdges
wires = BrepWireframe(Brep=optimalboundingbox.Obb, Density=-1)
merge_3 = Merge(Data1=medges_2.NakedEdges, Data2=medges_2.InteriorEdges, Data3=medges_2.NonManifoldEdges)
preview_2 = CustomPreview(Geometry=mesh, Material=ColourSwatch(SwatchColor=RGBA(91, 143, 136, 106)))
preview_3 = CustomPreview(Geometry=merge_3, Material=ColourSwatch(SwatchColor=RGB(21, 255, 0)))
preview_4 = CustomPreview(Geometry=wires, Material=ColourSwatch(SwatchColor=RGB(255, 0, 0)))

wires_2 = BrepWireframe(Brep=optimalboundingbox_points.Obb, Density=-1)
preview_5 = CustomPreview(Geometry=wires_2, Material=ColourSwatch(SwatchColor=RGB(255, 0, 0)))

pline_4 = PolyLine(Vertices=convexhull_2.ConvexHull, Closed=True)
preview_6 = CustomPreview(Geometry=pline_4, Material=ColourSwatch(SwatchColor=RGB(21, 255, 0)))

preview_7 = CustomPreview(Geometry=boundingcircle.Sphere, Material=ColourSwatch(SwatchColor=RGBA(0, 187, 255, 106)))

pline_5 = PolyLine(Vertices=boundingrectangle.Rectangle, Closed=True)
preview_8 = CustomPreview(Geometry=pline_5, Material=ColourSwatch(SwatchColor=RGB(255, 0, 0)))

preview_9 = CustomPreview(Geometry=boundingcircle_2.Circle, Material=ColourSwatch(SwatchColor=RGB(0, 255, 238)))

preview_10 = CustomPreview(Geometry=merge_2, Material=ColourSwatch(SwatchColor=RGB(21, 255, 0)))

preview_11 = CustomPreview(Geometry=[pline, merge], Material=ColourSwatch(SwatchColor=RGB(251, 255, 0)))
preview_12 = CustomPreview(Geometry=straightskeleton.StraightSkeleton, Material=ColourSwatch(SwatchColor=RGB(76, 176, 0)))
preview_13 = CustomPreview(Geometry=straightskeleton.Envelope, Material=ColourSwatch(SwatchColor=RGB(143, 127, 127)))
preview_14 = CustomPreview(Geometry=straightskeleton.Spokes, Material=ColourSwatch(SwatchColor=RGB(70, 112, 38)))
