# Grasshopper definition CgalTest.gh (Grasshopper 1.0.7)

dll = ImportDll(asm="CgalUtilWrapper.dll", config=Slider(0, range=0..1))  # -> dll; inputs config: Int32
# ---------- dll: Python ----------
ghenv.Component.Name = "Import Dll"
ghenv.Component.NickName = "Dll"

import rhinoscriptsyntax as rs
import System.IO as io
import clr

cwd = io.Path.GetDirectoryName(ghenv.Component.OnPingDocument().FilePath) + "/spec/"
io.Directory.SetCurrentDirectory(cwd)

thisDir = rs.DocumentPath();
binDir = io.Directory.GetParent(thisDir).Parent.FullName + "\\x64\\" + ("Release" if config == 1 else "Debug") + "\\"
asmPath = binDir + asm
dll = asmPath

clr.AddReferenceToFileAndPath(asmPath)
# ---------- end dll ----------

pt = Point([Point(99.05031315, -25.99788091, 0), Point(58.70649606, -81.62192912, 0), Point(112.7102603, -71.74786252, 0)])
pt_2 = Point([Point(-17.81812329, 26.69048654, 0), Point(17.19715638, 49.76040107, 0), Point(4.615978363, 13.3552902, 0), Point(24.42464163, -44.46459178, 0), Point(-41.6688246, -13.42205658, 0)])
pt_3 = Point([Point(33.52591935, 24.86572966, 0), Point(57.63682268, 57.91322281, 0), Point(96.2315939, 17.80067969, 0), Point(52.33989619, -27.40118184, 0)])
pt_4 = Point([Point(54.40490909, 85.79482679, 0), Point(-2.66676122, 65.30286978, 0), Point(-35.40726939, 45.3550105, 0), Point(-57.95702336, 2.857397249, 0), Point(-41.91200611, -46.57860184, 0), Point(25.49538019, -109.511959, 0), Point(170.9674266, -107.1648866, 0), Point(128.7966889, 5.404275297, 0), Point(91.04208104, 68.93855822, 0)])
pline = PolyLine(Vertices=pt, Closed=True)
pline_2 = PolyLine(Vertices=pt_2, Closed=True)
pline_3 = PolyLine(Vertices=pt_3, Closed=True)
pline_4 = PolyLine(Vertices=pt_4, Closed=True)
merge = Merge(Data1=pline_3, Data2=pline_2, Data3=pline)  # -> flatten(Result)

c_script = CSharpScript(path="spec/StraightSkeleton.py", refresh=Button())  # -> out, A; inputs path: String, refresh: Boolean
# ---------- c_script: C# usings ----------
using System.IO;
# ---------- c_script: C# ----------
    string thisDir = Path.GetDirectoryName(this.Component.OnPingDocument().FilePath);
        string file = File.ReadAllText(thisDir + @"\" + path);
    A = file;
# ---------- end c_script ----------
straightskeletontest = Instance(Code=c_script.A, Dll=dll, Outer=pline_4, Inner=merge)  # -> Out, StraightSkeleton, Spokes, Envelope
panel = Panel(straightskeletontest.Out)

preview = CustomPreview(Geometry=[pline_4, merge], Material=ColourSwatch(SwatchColor=RGB(251, 255, 0)))
preview_2 = CustomPreview(Geometry=straightskeletontest.StraightSkeleton, Material=ColourSwatch(SwatchColor=RGB(76, 176, 0)))
preview_3 = CustomPreview(Geometry=straightskeletontest.Envelope, Material=ColourSwatch(SwatchColor=RGB(143, 127, 127)))
preview_4 = CustomPreview(Geometry=straightskeletontest.Spokes, Material=ColourSwatch(SwatchColor=RGB(70, 112, 38)))
